# Dynamo graph Roof Drain 01 - Calculate Area.dyn (Dynamo 1.3.4.6666)

# group: Get all Detail Item Elements in project and filter in Filled Regions only
categories = Categories("DetailComponents")
all_elements_of_category = ElementsOfCategory(categories)
string_from_object = FromObject(all_elements_of_category)
string = StringInput("FilledRegion")
eq = string_from_object == string
filterByBoolMask = List.FilterByBoolMask(list=all_elements_of_category, mask=eq)

watch = Watch(all_elements_of_category)
watch_2 = Watch(eq)

# group: Get Filled Regions Area Values
string_2 = StringInput("Area")
getParameterValueByName = Element.GetParameterValueByName(element=filterByBoolMask.in, parameterName=string_2)

# group: Set Filled Region Area parameters with Area values
string_3 = StringInput("Filled Region Area")
setParameterByName = Element.SetParameterByName(element=filterByBoolMask.in, parameterName=string_3, value=getParameterValueByName)
