# Dynamo graph Roof Drain 02 - Calculate Flow.dyn (Dynamo 1.3.4.6666)

# group: 1. Automatic selection of All Plumbing Fixtures in the Project
categories = Categories("PipeFitting")
all_elements_of_category = ElementsOfCategory(categories)
watch = Watch(all_elements_of_category)

# group: 3. Pick-select Detail Items and filter in Filled Regions only
boolean = BoolSelector(false)
categories_2 = Categories("DetailComponents")
isolated_pick_model_elements = Custom[Isolated Pick Model Elements](refresh=boolean, category=categories_2)  # This allows a multiple selection of elements of specified category.
string_from_object = FromObject(isolated_pick_model_elements)
string = StringInput("FilledRegion")
eq = string_from_object == string
filterByBoolMask = List.FilterByBoolMask(list=isolated_pick_model_elements, mask=eq)

# group: 4. Automatic Validation the Roof Area Type is used
string_2 = StringInput("Roof Area")
elementType = Element.ElementType(filterByBoolMask.in)
name = Element.Name(elementType)
watch_2 = Watch(name)
eq_2 = string_2 == watch_2
watch_3 = Watch(eq_2)
filterByBoolMask_2 = List.FilterByBoolMask(list=filterByBoolMask.in, mask=eq_2)

# group: 5. Automatic Validation the Vertical Wall Area Type is used
string_3 = StringInput("Vertical Wall Area")
elementType_2 = Element.ElementType(filterByBoolMask.in)
name_2 = Element.Name(elementType_2)
watch_4 = Watch(name_2)
eq_3 = string_3 == watch_4
watch_5 = Watch(eq_3)
filterByBoolMask_3 = List.FilterByBoolMask(list=filterByBoolMask.in, mask=eq_3)

# group: 6. Get the Sum of Area Values from Roof Area Filled Regions
string_4 = StringInput("Area")
getParameterValueByName = Element.GetParameterValueByName(element=filterByBoolMask_2.in, parameterName=string_4)
sum = Math.Sum(getParameterValueByName)
watch_6 = Watch(sum)

# group: 2. Pick-select Roof Drain
boolean_2 = BoolSelector(false)
categories_3 = Categories("PipeFitting")
isolated_pick_model_elements_2 = Custom[Isolated Pick Model Elements](refresh=boolean_2, category=categories_3)

# group: 9. Set the _Roof_Area value of Roof Drain
string_5 = StringInput("_Roof_Area")
setParameterByName = Element.SetParameterByName(element=isolated_pick_model_elements_2, parameterName=string_5, value=sum)
watch_7 = Watch(setParameterByName)

# group: 7. Get the Sum of Area Values from Vertical Wall Area Filled Regions
string_6 = StringInput("Area")
getParameterValueByName_2 = Element.GetParameterValueByName(element=filterByBoolMask_3.in, parameterName=string_6)
sum_2 = Math.Sum(getParameterValueByName_2)
watch_8 = Watch(sum_2)

# group: 10. Set the _Vertical_Wall_Area value of Roof Drain
string_7 = StringInput("_Roof_Vertical_Wall_Area")
setParameterByName_2 = Element.SetParameterByName(element=isolated_pick_model_elements_2, parameterName=string_7, value=sum_2)
watch_9 = Watch(setParameterByName_2)

# group: 8. Sets the _Rainfall Value for all Types
elementType_3 = Element.ElementType(all_elements_of_category)
code_block = CodeBlock { "_Rainfall"; }
code_block_2 = CodeBlock { 2.1; }
setParameterByNameTypeOrInstance = Rhythm.Revit.Elements.Elements.SetParameterByNameTypeOrInstance(elementType_3, code_block, code_block_2)
watch_10 = Watch(setParameterByNameTypeOrInstance)
