# Dynamo graph Roof Drain 03 - Pipe Fitting Flow.dyn (Dynamo 2.0.2.6826)

# group: 1. Select All Pipe Fittings of Plumbing - Roof Drain System
categories = Categories(index=343)  # graph input
all_elements_of_category = ElementsOfCategory(Category=categories)
mechanicalfitting_info = Custom[MechanicalFitting info](Fittings=all_elements_of_category)  # Gets the fitting Part Type and number of connectors
string_from_object = FromObject(obj=mechanicalfitting_info.Part_Type)
code_block = CodeBlock(X=string_from_object) { X=="Transition"; }
filterByBoolMask = List.FilterByBoolMask(list=all_elements_of_category, mask=code_block)
string = StringInput("Storm Drain - Flow")  # graph input
code_block_2 = CodeBlock { "System Type"; }
getParameterValueByName = Element.GetParameterValueByName(element=filterByBoolMask.out, parameterName=code_block_2)
name = Element.Name(element=getParameterValueByName)
eq = string == name
filterByBoolMask_2 = List.FilterByBoolMask(list=filterByBoolMask.out, mask=eq)

# group: 2. Add Flow to Fittings based on connected pipes calculated Flow.
code_block_3 = CodeBlock { "Flow"; }
mep_fitting_connected_mepcurves = Custom[MEP Fitting connected MEPCurves](Fittings=filterByBoolMask_2.in)  # Returns the pipes, ducts, conduits or cable trays that are connected to the given fittings
code_block_4 = CodeBlock { "Flow"; }
getParameterValueByName_2 = Element.GetParameterValueByName(element=mep_fitting_connected_mepcurves, parameterName=code_block_4)
maximumItem = List.MaximumItem(list=getParameterValueByName_2)
setParameterByName = Element.SetParameterByName(element=filterByBoolMask_2.in, parameterName=code_block_3, value=maximumItem)
watch = Watch(setParameterByName)
