# Dynamo graph Roof Drain 04 - Export Excel.dyn (Dynamo 2.0.2.6826)

# group: 1. Select All Pipes of Plumbing - Storm Drain System
string = StringInput("Storm Drain - Flow")  # graph input
categories = Categories(index=350)
all_elements_of_category = ElementsOfCategory(Category=categories)
categories_2 = Categories(index=343)
all_elements_of_category_2 = ElementsOfCategory(Category=categories_2)
mechanicalfitting_info = Custom[MechanicalFitting info](Fittings=all_elements_of_category_2)  # Gets the fitting Part Type and number of connectors
string_from_object = FromObject(obj=mechanicalfitting_info.Part_Type)
code_block = CodeBlock(X=string_from_object) { X=="Transition"; }
filterByBoolMask = List.FilterByBoolMask(list=all_elements_of_category_2, mask=code_block)
join = List.Join(list0=all_elements_of_category, list1=filterByBoolMask.out)
code_block_2 = CodeBlock { "System Type"; }
getParameterValueByName = Element.GetParameterValueByName(element=join, parameterName=code_block_2)
name = Element.Name(element=getParameterValueByName)
eq = string == name
watch = Watch(eq)
filterByBoolMask_2 = List.FilterByBoolMask(list=join, mask=eq)

id = Element.Id(element=filterByBoolMask_2.in)
code_block_3 = CodeBlock { "System Name"; }
getParameterValueByName_2 = Element.GetParameterValueByName(element=filterByBoolMask_2.in, parameterName=code_block_3)
code_block_4 = CodeBlock { "Slope"; }
getParameterValueByName_3 = Element.GetParameterValueByName(element=filterByBoolMask_2.in, parameterName=code_block_4)
code_block_5 = CodeBlock { "Flow"; }
getParameterValueByName_4 = Element.GetParameterValueByName(element=filterByBoolMask_2.in, parameterName=code_block_5)
code_block_6 = CodeBlock { "Diameter"; }
getParameterValueByName_5 = Element.GetParameterValueByName(element=filterByBoolMask_2.in, parameterName=code_block_6)
code_block_7 = CodeBlock { ""; }
eq_2 = getParameterValueByName_5 == code_block_7
code_block_8 = CodeBlock { "Nominal Diameter"; }
getParameterValueByName_6 = Element.GetParameterValueByName(element=filterByBoolMask_2.in, parameterName=code_block_8)
if_ = If(test=eq_2, true=getParameterValueByName_6, false=getParameterValueByName_5)
create = List.Create(item0=id, item1=getParameterValueByName_2, item2=getParameterValueByName_3, item3=getParameterValueByName_4, item4=if_)

# group: 3. Export Pipe Parameters to Excel
file_path = Filename(".\StormWritePipeDataToExcel.xlsx")  # graph input
string_2 = StringInput("StormCalcs")  # graph input
number = DoubleInput(3)  # graph input
number_2 = DoubleInput(0)  # graph input
transpose = List.Transpose(lists=create)
boolean = BoolSelector(false)  # graph input
exportExcel = Data.ExportExcel(filePath=file_path, sheetName=string_2, startRow=number, startCol=number_2, data=transpose, overWrite=boolean)
