# Dynamo graph Roof Drain 05 - Import Excel.dyn (Dynamo 1.3.4.6666)

# group: 1. Select All Pipes of Plumbing - Storm Drain System
string = StringInput("Storm Drain")
element_types = ElementTypes("Pipe")
all_elements_of_type = ElementsOfType(element_types)
code_block = CodeBlock { "System Type"; }
getParameterValueByName = Element.GetParameterValueByName(element=all_elements_of_type, parameterName=code_block)
name = Element.Name(getParameterValueByName)
eq = string == name
watch = Watch(eq)
filterByBoolMask = List.FilterByBoolMask(list=all_elements_of_type, mask=eq)

# group: 2. Import Pipe Diameter sized in Excel into Revit
file_path = Filename(".\StormWritePipeDataToExcel.xlsx")
fromPath = FileObject(file_path)  # "File.FromPath"
string_2 = StringInput("StormCalcs")
readFromFile = Excel.ReadFromFile(file=fromPath@L2, sheetName=string_2)
transpose = List.Transpose(readFromFile)
code_block_2 = CodeBlock { 4; }
getItemAtIndex = List.GetItemAtIndex(list=transpose@L2, index=code_block_2)
code_block_3 = CodeBlock { "Diameter"; }

watch_2 = Watch(getItemAtIndex)

# group: 3. Resize Pipe Diameters in Revit
setParameterByName = Element.SetParameterByName(element=filterByBoolMask.in, parameterName=code_block_3, value=getItemAtIndex)
